# Grasshopper definition 001_DifferentialGrowth.gh (Grasshopper 1.0.7)
# plug-ins: Anemone

distance_between_segments = Slider(2, range=0..10)
curve = Curve(<curve referenced from the Rhino model>)
divide_length = DivideLength(Curve=curve, Length=distance_between_segments)  # -> Points, Tangents, Parameters
loop_start = LoopStart(Repeat="400", Trigger=Button(), Data=divide_length.Points)  # -> port, Counter, Data

# ---- group: Flockmates Separation Direction
point = Point(loop_start.Data)
closest_points = ClosestPoints(Point=point, Cloud=point, Count="5")  # -> ClosestPoint, CPIndex, Distance
smaller_than = SmallerThan(FirstNumber=closest_points.Distance, SecondNumber=distance_between_segments)  # -> SmallerThan, OrEqualTo
vector_2pt = Vector2Pt(PointA=closest_points.ClosestPoint, PointB=graft(point), Unitize=False)  # -> Vector, Length
cull_pattern = CullPattern(List=vector_2pt.Vector, CullPattern=smaller_than.SmallerThan)

# ----
panel = Panel(loop_start.Counter)

# ---- group: Vector Strength
vector_length = VectorLength(Vector=cull_pattern)
bounds = Bounds(Numbers=vector_length)
unit_vector = UnitVector(Vector=cull_pattern)
deconstruct_domain = DeconstructDomain(Domain=bounds)  # -> Start, End
construct_domain = ConstructDomain(DomainStart=deconstruct_domain.End, DomainEnd=deconstruct_domain.Start)
remap_numbers = RemapNumbers(Value=vector_length, Source=bounds, Target=construct_domain)  # -> Mapped, Clipped
multiplication = Multiplication(A=remap_numbers.Mapped, B=Slider(0.5, range=0..1))
amplitude = Amplitude(Vector=unit_vector, Amplitude=multiplication)

# ---- group: Add Vector to Point
average = Average(Input=amplitude)
addition = Addition(A=graft(loop_start.Data), B=average)  # -> flatten(Result)

# ---- group: Insert Points for Growth
shift_list = ShiftList(List=addition, Shift=1, Wrap=True)
point_2 = Point(simplify(graft(addition)))
point_3 = Point(simplify(graft(shift_list)))
distance = Distance(PointA=point_2, PointB=point_3)
average_2 = Average(Input=[point_2, point_3])  # -> flatten(ArithmeticMean)
multiplication_2 = Multiplication(A=distance_between_segments, B=Slider(0.75, range=0..1))
list_length = ListLength(List=flatten(distance))
larger_than = LargerThan(FirstNumber=distance, SecondNumber=multiplication_2)  # -> flatten(LargerThan), OrEqualTo
series = Series(Start=0, Step=1, Count=list_length)
cull_pattern_2 = CullPattern(List=series, CullPattern=larger_than.LargerThan)
list_item = ListItem(List=average_2, Index=cull_pattern_2, Wrap=True)
insert_items = InsertItems(List=addition, Item=list_item, Indices=expr("x + 1", cull_pattern_2), Wrap=True)

# ----
loop_end = LoopEnd(port=loop_start.port, Exit=Toggle(True), Data=insert_items, TimeOutVal=0, pausedState=False, state="Constant output")
polyline = PolyLine(Vertices=loop_end, Closed=invert(False))
