# Grasshopper definition EncodeDesign.gh (Grasshopper 1.0.7)

crv = Curve(<curve referenced from the Rhino model>)

division_distance = Slider(0.02, range=0..0.1)
len = Length(Curve=crv)
division = Division(A=len, B=division_distance)
divide = DivideCurve(Curve=crv, Count=division, Kinks=True)  # -> Points, Tangents, Parameters

# ----
# Visualize Robot Model (Cannot plan here)
reload_urdf = Button()
load_tool = GhPythonScript()  # -> out, tool_model
# ---------- load_tool: Python ----------
import rhinoscriptsyntax as rs
from compas.data import DataDecoder, DataEncoder
import json
import os

this_file_location = os.path.dirname(rs.DocumentPath())
tool_json_location = os.path.abspath(os.path.join(
    this_file_location,
    "..", "..",
    "tool","otto1","otto1.json"
    ))
    
with open(tool_json_location, 'r') as f:
    tool_model = json.load(f, cls=DataDecoder)
# ---------- end load_tool ----------
load_robot_for_visualization = GhPythonScript(x=reload_urdf)  # -> out, robot
# ---------- load_robot_for_visualization: Python ----------
import rhinoscriptsyntax as rs

import compas
import compas_fab
import os

this_file_location = os.path.dirname(rs.DocumentPath())
robot_package_location = os.path.abspath(os.path.join(
    this_file_location,
    "..", "..",
    "robot"
    ))
robot_urdf_location = os.path.abspath(os.path.join(
    this_file_location,
    "..", "..",
    "robot","abb_crb15000_support",
    "urdf", "crb15000_5_95.urdf"
    ))
robot_srdf_location = os.path.abspath(os.path.join(
    this_file_location,
    "..", "..",
    "robot","abb_crb15000_support",
    "srdf", "abb_crb15000_5_95.srdf"
    ))

# Set high precision to import meshes defined in meters
compas.PRECISION = '12f'

# Create robot model from URDF
from compas.robots import RobotModel
robot_model = RobotModel.from_urdf_file(robot_urdf_location)

# Load Link Geometry
from compas.robots import LocalPackageMeshLoader
loader = LocalPackageMeshLoader(robot_package_location, 'abb_crb15000_support')
robot_model.load_geometry(loader)

# Load Robot Semantics from srdf
from compas_fab.robots import RobotSemantics
semantics = RobotSemantics.from_srdf_file(robot_srdf_location, robot_model)

print(robot_model)
for i, link in enumerate(robot_model.links):
    print ("Link [{}]: {}".format(i, link.name))
    
# Create compas_fab Robot object
from compas_ghpython.artists import RobotModelArtist
from compas_fab.robots import Robot
artist = RobotModelArtist(robot_model)

robot = Robot(robot_model, artist, semantics) # compas_fab Robot object
# ---------- end load_robot_for_visualization ----------
python = GhPythonScript(robot=load_robot_for_visualization.robot, tool_model=load_tool.tool_model, tool_to_link_name="tool0")  # -> out, robot, tool
# ---------- python: Python ----------
import rhinoscriptsyntax as rs
from compas_ghpython.artists import RobotModelArtist
from compas.geometry import Transformation, Frame
from compas_fab.robots import Robot

# Defining the link where the tool is attached to
tool_model.link_name = tool_to_link_name 

from compas_fab.robots import Tool
tool = Tool.from_tool_model(tool_model)
robot.attach_tool(tool, robot.main_group_name)
# ---------- end python ----------
update_robot = GhPythonScript(
    robot=python.robot,
    J1=Slider(0, range=0..1),
    J2=Slider(0, range=0..1),
    J3=Slider(0, range=0..1),
    J4=Slider(0, range=0..1),
    J5=Slider(0.7, range=0..1),
    J6=Slider(0, range=0..1))  # -> out, robot, configuration
# ---------- update_robot: Python ----------
import rhinoscriptsyntax as rs
configuration = robot.model.zero_configuration()
configuration['joint_1'] = J1
configuration['joint_2'] = J2
configuration['joint_3'] = J3
configuration['joint_4'] = J4
configuration['joint_5'] = J5
configuration['joint_6'] = J6
robot.update(configuration)
print (configuration)
# ---------- end update_robot ----------
python_2 = GhPythonScript(robot=update_robot.robot)  # -> out, robot_visual_meshes, robot_collision_meshes
# ---------- python_2: Python ----------
robot_visual_meshes = robot.artist.draw_visual()
robot_collision_meshes = robot.artist.draw_collision()
# ---------- end python_2 ----------

tilting_angle_degrees = Slider(20, range=0..100)
environment_collision_mesh = Mesh([<mesh referenced from the Rhino model> x3])
start_end_height = Slider(0.3, range=-0.5..0.5)
tri = Triangulate(Mesh=environment_collision_mesh)  # -> Mesh, Count
# Last Point (Vertical)
item = ListItem(List=divide.Points, Index=-1, Wrap=True)
# First Point and Onwards
shift = ShiftList(List=divide.Points, Shift=-1, Wrap=False)
shift_2 = ShiftList(List=divide.Points, Shift=1, Wrap=False)
save = Button()
vec2pt = Vector2Pt(PointA=shift, PointB=shift_2, Unitize=False)  # -> Vector, Length
pt = ConstructPoint(XCoordinate=0, YCoordinate=0, ZCoordinate=start_end_height)
Z = UnitZ(Factor=1)
save_collision_meshes = GhPythonScript(meshes=tri.Mesh, file_name="CollisionMesh1_Table", save=save)  # -> out, json_path; inputs meshes: list of Mesh
# ---------- save_collision_meshes: Python ----------
from compas.datastructures import Mesh
from compas_rhino.conversions import RhinoMesh
compas_meshes = [RhinoMesh.from_geometry(mesh).to_compas() for mesh in meshes]

from compas.data import DataEncoder, json_dump
from Rhino.RhinoDoc import ActiveDoc
import os
json_path = os.path.split(ActiveDoc.Path)[0] + os.path.sep + file_name +".json"
if save:
    json_dump(compas_meshes, json_path)
# ---------- end save_collision_meshes ----------
item_2 = ListItem(List=vec2pt.Vector, Index=-1, Wrap=True)
xy = XYPlane(Origin=pt)
xprod = CrossProduct(VectorA=vec2pt.Vector, VectorB=Z, Unitize=False)  # -> Vector, Length
item_3 = ListItem(List=xprod.Vector, Index=-1, Wrap=True)
neg = Negative(Value=tilting_angle_degrees)
vrot = Rotate(Vector=vec2pt.Vector, Axis=xprod.Vector, Angle=degrees(neg))
pl = ConstructPlane(Origin=item, XAxis=item_2, YAxis=item_3)
pl_2 = ConstructPlane(Origin=shift, XAxis=vrot, YAxis=xprod.Vector)
merge = Merge(Data1=pl_2, Data2=pl)
X = UnitX(Factor="-1")
align = AlignPlane(Plane=merge, Direction=X)  # -> Plane, Angle
item_4 = ListItem(List=align.Plane, Index="0", Wrap=True)
item_5 = ListItem(List=align.Plane, Index="-1", Wrap=True)
project = Project(Geometry=item_5, Plane=xy)  # -> Geometry, Transform
project_2 = Project(Geometry=item_4, Plane=xy)  # -> Geometry, Transform

# ----
# Visualize Print Rod
deplane = DeconstructPlane(Plane=align.Plane)  # -> Origin, XAxis, YAxis, ZAxis
line = LineSDL(Start=deplane.Origin, Direction=deplane.ZAxis, Length=Slider(0.15, range=0..1))

printing_frames = Data(align.Plane)
split = SplitList(List=printing_frames, Index="1")  # -> ListA, ListB
remaining_printing_frame = Data(split.ListB)
lng = ListLength(List=remaining_printing_frame)
# Create Planning Skeleton
start_configuration = Data(update_robot.configuration)
first_printing_frame = Data(split.ListA)
approach_frame = Data(project_2.Geometry)
retract_frame = Data(project.Geometry)
series = Series(Start=1, Step=1, Count=lng)
int = Integer(series)
concat = Concatenate(FragmentA="Printing point", FragmentB=int, FragmentC=" of ", FragmentD=lng)
freemovement = GhPythonScript(target_frame=approach_frame, speed_type="freemove", tag="Go To Approach")  # -> task; inputs target_frame: Plane
# ---------- freemovement: Python ----------
from npp.tasks import *

from compas_rhino.conversions import RhinoPlane
from compas_fab.robots import Configuration

from npp.tasks import RoboticFreeMovement

m = RoboticFreeMovement()
if target_configuration is not None:
    assert type(target_configuration) == Configuration
    m.target_configuration = target_configuration
    if target_frame is not None:
        print("target_frame will be ignored because configuration is present")
else:
    m.target_frame = RhinoPlane.from_geometry(target_frame).to_compas_frame()
m.speed_type = speed_type
m.tag = tag

task = m
# ---------- end freemovement ----------
linearmovement = GhPythonScript(target_frame=first_printing_frame, speed_type="approach", tag="Inserting Printhead")  # -> task; inputs target_frame: Plane
# ---------- linearmovement: Python ----------
from npp.tasks import *

from compas_rhino.conversions import RhinoPlane
from compas_fab.robots import Configuration

from npp.tasks import RoboticLinearMovement

m = RoboticLinearMovement()
if target_configuration is not None:
    assert type(target_configuration) == Configuration
    m.target_configuration = target_configuration
    if target_frame is not None:
        print("target_frame will be ignored because configuration is present")
else:
    m.target_frame = RhinoPlane.from_geometry(target_frame).to_compas_frame()
m.speed_type = speed_type
m.tag = tag

task = m
# ---------- end linearmovement ----------
linearmovement_2 = GhPythonScript(target_frame=remaining_printing_frame, speed_type="print", tag=concat)  # -> task; inputs target_frame: Plane; same code as linearmovement
linearmovement_3 = GhPythonScript(target_frame=retract_frame, speed_type="retract", tag="Withdrawing Printhead")  # -> task; inputs target_frame: Plane; same code as linearmovement
freemovement_2 = GhPythonScript(target_configuration=start_configuration, speed_type="freemove", tag="Go Back to Start Configuration")  # -> task; inputs target_frame: Plane; same code as freemovement
airassiton = GhPythonScript()  # -> task
# ---------- airassiton: Python ----------
from npp.tasks import AirAssistOn
task = AirAssistOn()
# ---------- end airassiton ----------
extruderon = GhPythonScript()  # -> task
# ---------- extruderon: Python ----------
from npp.tasks import ExtruderOn
task = ExtruderOn()
# ---------- end extruderon ----------
extruderoff = GhPythonScript()  # -> task
# ---------- extruderoff: Python ----------
from npp.tasks import ExtruderOff
task = ExtruderOff()
# ---------- end extruderoff ----------
airassitoff = GhPythonScript()  # -> task
# ---------- airassitoff: Python ----------
from npp.tasks import AirAssistOff
task = AirAssistOff()
# ---------- end airassitoff ----------
panel = Panel("""Available Tasks:
FreeMovement
LinearMovement
AirAssistOn
AirAssistOff
ExtruderOn
ExtruderOff""")
merge_2 = Merge(Data1=flatten(freemovement), Data2=flatten(airassiton), Data3=flatten(linearmovement))
merge_3 = Merge(Data1=flatten(extruderon), Data2=flatten(linearmovement_2), Data3=flatten(extruderoff))
merge_4 = Merge(Data1=flatten(linearmovement_3), Data2=flatten(airassitoff), Data3=flatten(freemovement_2))
merge_5 = Merge(Data1=flatten(merge_2), Data2=flatten(merge_3), Data3=flatten(merge_4))
panel_2 = Panel(merge_5)
save_2 = Button()
unload_modules = GhPythonScript(module_names="npp", unload=Button())  # -> out, a; inputs module_names: list
# ---------- unload_modules: Python ----------
from compas_rhino import unload_modules
if unload:
    [unload_modules(m) for m in module_names]
# ---------- end unload_modules ----------
unload_modules_2 = GhPythonScript(module_names="compas", unload=Button())  # -> out, a; inputs module_names: list; same code as unload_modules
planningpackage = GhPythonScript(
    robot=update_robot.robot,
    start_configuration=start_configuration,
    static_collision_meshes=tri.Mesh,
    tasks=merge_5,
    file_name="planning_problem_0_test",
    save=save_2)  # -> out, a; inputs static_collision_meshes: list of Mesh, tasks: list, save: Boolean
# ---------- planningpackage: Python ----------
from npp.tasks import PlanningProblem
from compas_rhino.conversions import RhinoMesh
pp = PlanningProblem()

# Fill in the planning problem
#pp.robot = robot
pp.start_configuration = start_configuration
pp.tasks = tasks

# Collision Meshes
from compas_fab.robots import CollisionMesh
cms = []
for i, mesh in enumerate(static_collision_meshes):
    cms.append(CollisionMesh(RhinoMesh.from_geometry(mesh).to_compas(), "static_collision_mesh_%i"%(i)))
pp.static_collision_meshes = cms

# Save
from Rhino.RhinoDoc import ActiveDoc
import os
json_path = os.path.split(ActiveDoc.Path)[0] + os.path.sep + file_name +".json"
from compas.data import json_dump
if save:
    json_dump(pp, json_path)
# ---------- end planningpackage ----------
