# Grasshopper definition 230814_FinalDemonstrator.gh (Grasshopper 1.0.7)
# plug-ins: Graphic Statics 3D

vec = VectorXYZ(XComponent=0, YComponent=0, ZComponent="30")  # -> Vector, Length
xy = XYPlane(Origin=Point(0, 0, 0))
pyramid = PyramidSolid(Plane=xy, Sides=4, BaseEdgeLength="80", TopEdgeLength="120", Height=vec.Vector)  # -> Brep, Mesh, RadiusBase, RadiusTop

crv = Curve([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])
crv_2 = Curve([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])
end = EndPoints(Curve=crv_2)  # -> Start, End
pt_optional = Point([Point(-0.3819552445, -1.800727266, 0), Point(-2.108156045, 0.7633608788, 0), Point(1.798039364, 0.6158941973, 0)])
ln = Line(StartPoint=end.Start, EndPoint=end.End)
brep = Brep(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)
inverse = ConstructorForINVERSEMethod(Lines=ln, Polyhedron=brep, ParallelComputing=True)  # -> _3DGS, PreviewBreps, PreviewLines

pt = ConstructPoint(XCoordinate=0, YCoordinate=0, ZCoordinate=expr("x*0.9", "30"))
brep_2 = Brep(pyramid.Brep)
xy_2 = XYPlane(Origin=pt)
sel_faces = SelectFacesEdges(Faces=brep_2, ExtractMethod="5", FaceIndices=0, Planes=xy_2)  # -> Faces, FaceIndex, Patern
subdiv_faces = SubdivideFacesEdges(Brep=brep_2, Index=sel_faces.FaceIndex, Subdiv=Slider(1, range=0..2), Parallel=True)  # -> Brep, Indices, SubdivLevels

pt_2 = ConstructPoint(XCoordinate=0, YCoordinate=0, ZCoordinate=expr("x*0.9", "30"))
brep_3 = Brep(subdiv_faces.Brep)
xy_3 = XYPlane(Origin=pt_2)
sel_faces_2 = SelectFacesEdges(Faces=brep_3, ExtractMethod="5", FaceIndices=0, Planes=xy_3)  # -> Faces, FaceIndex, Patern
subdiv_faces_2 = SubdivideFacesEdges(Brep=brep_3, Index=sel_faces_2.FaceIndex, Subdiv=Slider(1, range=0..2), Parallel=True)  # -> Brep, Indices, SubdivLevels

xy_4 = XYPlane(Origin=Point(0, 0, 0))
brep_4 = Brep(inverse.PreviewBreps)
sel_faces_3 = SelectFacesEdges(Faces=brep_4, ExtractMethod="4", FaceIndices=0, Planes=xy_4)  # -> Faces, FaceIndex, Patern
subdiv_faces_3 = SubdivideFacesEdges(Brep=brep_4, Index=sel_faces_3.FaceIndex, Subdiv=Slider(1, range=1..2), Parallel=True)  # -> Brep, Indices, SubdivLevels

brep_5 = Brep(subdiv_faces_2.Brep)
xy_5 = XYPlane(Origin=Point(0, 0, 0))
sel_faces_4 = SelectFacesEdges(Faces=brep_5, ExtractMethod="2", FaceIndices=0)  # -> Faces, FaceIndex, Patern
sel_faces_5 = SelectFacesEdges(Faces=brep_5, ExtractMethod="4", FaceIndices=0, Planes=xy_5)  # -> Faces, FaceIndex, Patern
or = GateOr(A=sel_faces_4.Patern, B=sel_faces_5.Patern)
boolean_list_to_integers = BooleanListToIntegers(Boolean=or)  # -> True, False
subdiv_faces_4 = SubdivideFacesEdges(Brep=brep_5, Index=boolean_list_to_integers.True, Subdiv=Slider(1, range=0..1), Parallel=True)  # -> Brep, Indices, SubdivLevels

pt_3 = ConstructPoint(XCoordinate=0, YCoordinate=0, ZCoordinate="10")
brep_6 = Brep(subdiv_faces_2.Brep)
xy_6 = XYPlane(Origin=pt_3)
pflip = FlipPlane(Plane=xy_6, ReverseX=False, ReverseY=False, SwapAxes=True)
sel_poly = SelectPolyhedraNodes(Polyhedra=brep_6, ExtractMethod=4, PolyhedraIndices=0, Plane=pflip)  # -> Polyhedra, PolyhedonIndex, Patern
subdiv_poly = SubdividePolyhedraNodes(Brep=brep_6, Index=sel_poly.PolyhedonIndex, Subdiv=1, Parallel=True)  # -> Brep, Indices, SubdivLevels

parallel = BooleanToggle(False)
brep_7 = Brep(flatten(subdiv_faces_3.Brep))
direct = ConstructorForDIRECTMethod(Breps=brep_7, ParallelComputing=parallel)  # -> _3DGS, PreviewLines

brep_v2 = Brep(subdiv_poly.Brep)
brep_v1 = Brep(subdiv_faces.Brep)
brep_v2_2 = Brep(subdiv_faces_2.Brep)
brep_v3 = Brep(subdiv_faces_4.Brep)

Y = UnitY(Factor=250)  # disabled
swatch = ColourSwatch(SwatchColor=RGBA(48, 124, 191, 13))  # disabled
move = Move(Geometry=brep_7, Motion=Y)  # -> Geometry, Transform; disabled
preview = CustomPreview(Geometry=move.Geometry, Material=swatch)  # disabled

scale_nu = ScaleNU(
    Geometry=brep_v2,
    Plane=PlaneXY(0, 0, 0),
    ScaleX=Slider(0.66, range=0..2),
    ScaleY=Slider(1, range=0..2),
    ScaleZ=Slider(1, range=0..2))  # -> Geometry, Transform

_3dgs_inverse = Data(inverse._3DGS)
_3dgs_direct = Data(direct._3DGS)
filter = StreamFilter(Gate=Slider(0, range=0..1), Stream0=_3dgs_inverse, Stream1=_3dgs_direct)
_3dgs = Data(filter)

parallel_2 = BooleanToggle(True)
brep_8 = Brep(flatten(scale_nu.Geometry))
direct_2 = ConstructorForDIRECTMethod(Breps=brep_8, ParallelComputing=parallel_2)  # -> _3DGS, PreviewLines

Y_2 = UnitY(Factor=250)
move_2 = Move(Geometry=brep_8, Motion=Y_2)  # -> Geometry, Transform
preview_2 = CustomPreview(Geometry=move_2.Geometry, Material=ColourSwatch(SwatchColor=RGBA(48, 124, 191, 13)))

max_iterations = Panel("2500")
min_edge_length = Panel("50")
parallel_3 = BooleanToggle(False)
trigger = BooleanToggle(False)
reset = Button()
angle_tol = Panel("0.01")
nth_preview = Panel("10")
run = BooleanToggle(True)
form_solver = FormSolver(
    _3DGS=_3dgs,
    ParallelComputing=parallel_3,
    Run=run,
    Reset=reset,
    Trigger=trigger,
    MaximumNumberOfIterations=max_iterations,
    AngleTolerance=angle_tol,
    MinEdgeLength=min_edge_length,
    PreviewNth=nth_preview)  # -> _3DGS, Preview, CurrentIteration, Angles_, AngleDomain
line = Line(form_solver.Preview)
iteration = Panel(form_solver.CurrentIteration)
angle_domain = Panel(form_solver.AngleDomain)

max_iterations_2 = Panel("10000")
min_edge_length_2 = Panel("10")
parallel_4 = BooleanToggle(True)
run_2 = BooleanToggle(True)
angle_tol_2 = Panel("0.1")
end_form_solver = EndFormSolver(
    _3DGS=_3dgs,
    ParallelComputing=parallel_4,
    Run=run_2,
    MaximumNumberOfIterations=max_iterations_2,
    AngleTolerance=angle_tol_2,
    MinEdgeLength=min_edge_length_2)  # -> _3DGS, Preview, FinalIteration, Angles_, AngleDomain
line_2 = Line(end_form_solver.Preview)
iteration_2 = Panel(end_form_solver.FinalIteration)
angle_domain_2 = Panel(end_form_solver.AngleDomain)

trigger_2 = Trigger(Interval=200, TimerInterval=200, Target=form_solver)

max_iterations_3 = Panel("2500")
min_edge_length_3 = Panel("50")
parallel_5 = BooleanToggle(False)
trigger_3 = BooleanToggle(False)
reset_2 = Button()
angle_tol_3 = Panel("0.01")
nth_preview_2 = Panel("10")
run_3 = BooleanToggle(True)
form_solver_2 = FormSolver(
    _3DGS=direct_2._3DGS,
    ParallelComputing=parallel_5,
    Run=run_3,
    Reset=reset_2,
    Trigger=trigger_3,
    MaximumNumberOfIterations=max_iterations_3,
    AngleTolerance=angle_tol_3,
    MinEdgeLength=min_edge_length_3,
    PreviewNth=nth_preview_2)  # -> _3DGS, Preview, CurrentIteration, Angles_, AngleDomain
line_3 = Line(form_solver_2.Preview)
iteration_3 = Panel(form_solver_2.CurrentIteration)
angle_domain_3 = Panel(form_solver_2.AngleDomain)

max_iterations_4 = Panel("10000")
min_edge_length_4 = Panel("10")
parallel_6 = BooleanToggle(True)
run_4 = BooleanToggle(True)
angle_tol_4 = Panel("0.1")
end_form_solver_2 = EndFormSolver(
    _3DGS=direct_2._3DGS,
    ParallelComputing=parallel_6,
    Run=run_4,
    MaximumNumberOfIterations=max_iterations_4,
    AngleTolerance=angle_tol_4,
    MinEdgeLength=min_edge_length_4)  # -> _3DGS, Preview, FinalIteration, Angles_, AngleDomain
iteration_4 = Panel(end_form_solver_2.FinalIteration)
angle_domain_4 = Panel(end_form_solver_2.AngleDomain)
line_4 = Line(end_form_solver_2.Preview)

trigger_4 = Trigger(Interval=200, TimerInterval=200, Target=form_solver_2)

index = Panel("0")
preview_domain = Panel("1 to 3")
force_n = Panel("1500")
colour_type = Panel("2")
update_forces = UpdateForceIntensity(
    _3DGS=end_form_solver._3DGS,
    ForceIndex=index,
    ForceIntensity_N=force_n,
    PreviewDomain=preview_domain,
    ColourType=colour_type)  # -> _3DGS, SelectedMesh, PreviewMeshes, PreviewLines, ForcesNInElements, Colours
mesh = Mesh(update_forces.PreviewMeshes)
medges = MeshEdges(Mesh=mesh)  # -> NakedEdges, InteriorEdges, NonManifoldEdges
preview_3 = CustomPreview(Geometry=mesh, Material=ColourSwatch(SwatchColor=RGB(33, 155, 217)))
preview_4 = CustomPreview(Geometry=medges.InteriorEdges, Material=ColourSwatch(SwatchColor=RGB(23, 110, 153)))

index_2 = Panel("0")
preview_domain_2 = Panel("1 to 5")
force_n_2 = Panel("1500")
colour_type_2 = Panel("2")
update_forces_2 = UpdateForceIntensity(
    _3DGS=end_form_solver_2._3DGS,
    ForceIndex=index_2,
    ForceIntensity_N=force_n_2,
    PreviewDomain=preview_domain_2,
    ColourType=colour_type_2)  # -> _3DGS, SelectedMesh, PreviewMeshes, PreviewLines, ForcesNInElements, Colours
swatch_2 = ColourSwatch(SwatchColor=RGB(33, 155, 217))  # disabled
swatch_3 = ColourSwatch(SwatchColor=RGB(23, 110, 153))  # disabled
mesh_2 = Mesh(update_forces_2.PreviewMeshes)  # disabled
medges_2 = MeshEdges(Mesh=mesh_2)  # -> NakedEdges, InteriorEdges, NonManifoldEdges; disabled
preview_5 = CustomPreview(Geometry=mesh_2, Material=swatch_2)  # disabled
preview_6 = CustomPreview(Geometry=medges_2.InteriorEdges, Material=swatch_3)  # disabled

_3dgs_2 = Data(update_forces._3DGS)

_3dgs_3 = Data(update_forces_2._3DGS)
out_length = Number("20")
bake = Boolean(Button())
path = Text("3DGS::Structure 01::Form Diagram")
z_offset = Number("0")
height = Number("400")
_3dgs_4 = Data(_3dgs_3)
e_edges = ExtractEdges(_3DGS=_3dgs_4, ExtractMethod=2, EdgeIndices=0)  # -> Lines, IndicesOfEdges, EdgeType, ForceType, ForceIntensity, AngleDeviation
e_edges_2 = ExtractEdges(_3DGS=_3dgs_4, ExtractMethod=1, EdgeIndices=0)  # -> Lines, IndicesOfEdges, EdgeType, ForceType, ForceIntensity, AngleDeviation
panel = Panel("""index
Type
Force
F[N]
Angle[°]""")
txt = Text(simplify(graft(panel)))
lng = ListLength(List=e_edges.Lines)
transform = Transform(line=e_edges.Lines, z_offset=z_offset, height=height)  # -> line_4, A_2, t1_2, t2_2
entwine = Entwine(
    Branch00=e_edges.IndicesOfEdges,
    Branch01=e_edges.EdgeType,
    Branch02=e_edges.ForceType,
    Branch03=e_edges.ForceIntensity,
    Branch04=e_edges.AngleDeviation,
    FlattenInputs=True)  # -> simplify(Result)
entwine_2 = Entwine(
    Branch00=e_edges_2.IndicesOfEdges,
    Branch01=e_edges_2.EdgeType,
    Branch02=e_edges_2.ForceType,
    Branch03=e_edges_2.ForceIntensity,
    Branch04=e_edges_2.AngleDeviation,
    FlattenInputs=True)  # -> simplify(Result)
transform_2 = Transform(Geometry=e_edges_2.Lines, Transform=transform.t1_2)
lng_2 = ListLength(List=e_edges_2.Lines)
repeat = RepeatData(Data=txt, Length=lng)  # -> simplify(Data)
flip = FlipMatrix(Data=entwine)
transform_3 = Transform(Geometry=transform_2, Transform=transform.t2_2)
flip_2 = FlipMatrix(Data=entwine_2)
repeat_2 = RepeatData(Data=txt, Length=lng_2)  # -> simplify(Data)
flip_3 = FlipMatrix(Data=repeat)
setlength = SetLength(line=transform_3, len=out_length)  # disabled
linedim = LineDimension(Line=transform.A_2, Text="{0:0.00}", Size="20")
flip_4 = FlipMatrix(Data=repeat_2)
panel_2 = Panel("Edge - Outer")  # disabled
panel_3 = Panel("Edges - Inner")  # disabled
panel_4 = Panel("Edge - Inner")  # disabled
panel_5 = Panel("Edges - Outer")  # disabled
swatch_4 = ColourSwatch(SwatchColor=RGB(48, 143, 191))  # disabled
swatch_5 = ColourSwatch(SwatchColor=RGB(31, 112, 153))  # disabled
attributes = Attributes(
    LayerName=panel_3,
    ObjectName=panel_4,
    LayerColour=swatch_4,
    ObjectColour=RGB(0, 0, 0),
    PlotColour=RGB(0, 0, 0),
    ColourSource=0,
    UserKeys=flip_3,
    UserValues=flip)  # -> flatten(Attributes); disabled
attributes_2 = Attributes(
    LayerName=panel_5,
    ObjectName=panel_2,
    LayerColour=swatch_5,
    ObjectColour=RGB(0, 0, 0),
    PlotColour=RGB(0, 0, 0),
    ColourSource=0,
    UserKeys=flip_4,
    UserValues=flip_2)  # -> flatten(Attributes); disabled
bake_object_v2 = BakeObjectV2(Bake=bake, Objects=transform.line_4, Attributes=attributes, ParentLayerPath=path)  # disabled
bake_object_v2_2 = BakeObjectV2(Bake=bake, Objects=setlength, Attributes=attributes_2, ParentLayerPath=path)  # disabled

panel_6 = Panel("3DGS::Test 01::Form Diagram")  # disabled
button = Button()  # disabled
panel_7 = Panel("0")  # disabled
panel_8 = Panel("100")  # disabled
panel_9 = Panel("10")  # disabled
out_length_2 = Number(panel_9)  # disabled
bake_2 = Boolean(button)  # disabled
path_2 = Text(panel_6)  # disabled
z_offset_2 = Number(panel_7)  # disabled
height_2 = Number(panel_8)  # disabled
_3dgs_5 = Data(_3dgs_2)  # disabled
e_edges_3 = ExtractEdges(_3DGS=_3dgs_5, ExtractMethod=2, EdgeIndices=0)  # -> Lines, IndicesOfEdges, EdgeType, ForceType, ForceIntensity, AngleDeviation; disabled
e_edges_4 = ExtractEdges(_3DGS=_3dgs_5, ExtractMethod=1, EdgeIndices=0)  # -> Lines, IndicesOfEdges, EdgeType, ForceType, ForceIntensity, AngleDeviation; disabled
panel_10 = Panel("""index
Type
Force
F[N]
Angle[°]""")  # disabled
txt_2 = Text(simplify(graft(panel_10)))  # disabled
lng_3 = ListLength(List=e_edges_3.Lines)  # disabled
transform_4 = Transform(line=e_edges_3.Lines, z_offset=z_offset_2, height=height_2)  # -> line_4, A_2, t1_2, t2_2; disabled
entwine_3 = Entwine(
    Branch00=e_edges_3.IndicesOfEdges,
    Branch01=e_edges_3.EdgeType,
    Branch02=e_edges_3.ForceType,
    Branch03=e_edges_3.ForceIntensity,
    Branch04=e_edges_3.AngleDeviation,
    FlattenInputs=True)  # -> simplify(Result); disabled
entwine_4 = Entwine(
    Branch00=e_edges_4.IndicesOfEdges,
    Branch01=e_edges_4.EdgeType,
    Branch02=e_edges_4.ForceType,
    Branch03=e_edges_4.ForceIntensity,
    Branch04=e_edges_4.AngleDeviation,
    FlattenInputs=True)  # -> simplify(Result); disabled
transform_5 = Transform(Geometry=e_edges_4.Lines, Transform=transform_4.t1_2)  # disabled
lng_4 = ListLength(List=e_edges_4.Lines)  # disabled
repeat_3 = RepeatData(Data=txt_2, Length=lng_3)  # -> simplify(Data); disabled
flip_5 = FlipMatrix(Data=entwine_3)  # disabled
transform_6 = Transform(Geometry=transform_5, Transform=transform_4.t2_2)  # disabled
flip_6 = FlipMatrix(Data=entwine_4)  # disabled
repeat_4 = RepeatData(Data=txt_2, Length=lng_4)  # -> simplify(Data); disabled
panel_11 = Panel("5")  # disabled
flip_7 = FlipMatrix(Data=repeat_3)  # disabled
setlength_2 = SetLength(line=transform_6, len=out_length_2)  # disabled
linedim_2 = LineDimension(Line=transform_4.A_2, Text="{0:0.00}", Size=panel_11)  # disabled
flip_8 = FlipMatrix(Data=repeat_4)  # disabled
panel_12 = Panel("Edge - Inner")  # disabled
panel_13 = Panel("Edge - Outer")  # disabled
panel_14 = Panel("Edges - Inner")  # disabled
panel_15 = Panel("Edges - Outer")  # disabled
swatch_6 = ColourSwatch(SwatchColor=RGB(48, 143, 191))  # disabled
swatch_7 = ColourSwatch(SwatchColor=RGB(31, 112, 153))  # disabled
attributes_3 = Attributes(
    LayerName=panel_14,
    ObjectName=panel_12,
    LayerColour=swatch_6,
    ObjectColour=RGB(0, 0, 0),
    PlotColour=RGB(0, 0, 0),
    ColourSource=0,
    UserKeys=flip_7,
    UserValues=flip_5)  # -> flatten(Attributes); disabled
attributes_4 = Attributes(
    LayerName=panel_15,
    ObjectName=panel_13,
    LayerColour=swatch_7,
    ObjectColour=RGB(0, 0, 0),
    PlotColour=RGB(0, 0, 0),
    ColourSource=0,
    UserKeys=flip_8,
    UserValues=flip_6)  # -> flatten(Attributes); disabled
bake_object_v2_3 = BakeObjectV2(Bake=bake_2, Objects=transform_4.line_4, Attributes=attributes_3, ParentLayerPath=path_2)  # disabled
bake_object_v2_4 = BakeObjectV2(Bake=bake_2, Objects=setlength_2, Attributes=attributes_4, ParentLayerPath=path_2)  # disabled

panel_16 = Panel("3DGS::Test 01::Form Diagram")  # disabled
button_2 = Button()  # disabled
bake_3 = Boolean(button_2)  # disabled
path_3 = Text(panel_16)  # disabled
_3dgs_6 = Data(_3dgs_2)  # disabled
e_nodes = ExtractNodes(_3DGS=_3dgs_6, ExtractMethod=0, NodeIndices=0)  # -> LocationsUpdated, IndicesOfNodes, NodeTypes, Forces, NeighboringNodesI, NeighboringEdgesI; disabled
panel_17 = Panel("""index
Type
Forces
Neighboring_Nodes
Neighboring_Edges""")  # disabled
entwine_5 = Entwine(
    Branch00=e_nodes.IndicesOfNodes,
    Branch01=e_nodes.NodeTypes,
    Branch02=e_nodes.Forces,
    Branch03=e_nodes.NeighboringNodesI,
    Branch04=e_nodes.NeighboringEdgesI,
    FlattenInputs=True)  # -> simplify(Result); disabled
txt_3 = Text(simplify(graft(panel_17)))  # disabled
transform_7 = Transform(Geometry=e_nodes.LocationsUpdated, Transform=transform_4.t1_2)  # disabled
lng_5 = ListLength(List=e_nodes.LocationsUpdated)  # disabled
repeat_5 = RepeatData(Data=txt_3, Length=lng_5)  # -> simplify(Data); disabled
transform_8 = Transform(Geometry=transform_7, Transform=transform_4.t2_2)  # disabled
flip_9 = FlipMatrix(Data=entwine_5)  # disabled
flip_10 = FlipMatrix(Data=repeat_5)  # disabled
panel_18 = Panel("Nodes")  # disabled
panel_19 = Panel("Node")  # disabled
swatch_8 = ColourSwatch(SwatchColor=RGB(191, 48, 48))  # disabled
attributes_5 = Attributes(
    LayerName=panel_18,
    ObjectName=panel_19,
    LayerColour=swatch_8,
    ObjectColour=RGB(0, 0, 0),
    PlotColour=RGB(0, 0, 0),
    ColourSource=0,
    UserKeys=flip_10,
    UserValues=flip_9)  # -> flatten(Attributes); disabled
bake_object_v2_5 = BakeObjectV2(Bake=bake_3, Objects=transform_8, Attributes=attributes_5, ParentLayerPath=path_3)  # disabled

panel_20 = Panel("3DGS::Test 01::Force Diagram")  # disabled
button_3 = Button()  # disabled
bake_4 = Boolean(button_3)  # disabled
path_4 = Text(panel_20)  # disabled
_3dgs_7 = Data(_3dgs_2)  # disabled
e_polyhedra = ExtractPolyhedra(_3DGS=_3dgs_7, ExtractMethod=0, PolyhedraIndices=0)  # -> PolyhedronAsBrep, PolyhedronIndex, Centroid, PolyhedronType; disabled
panel_21 = Panel("""index
Type""")  # disabled
entwine_6 = Entwine(Branch00=e_polyhedra.PolyhedronIndex, Branch01=e_polyhedra.PolyhedronType, FlattenInputs=True)  # -> simplify(Result); disabled
txt_4 = Text(simplify(graft(panel_21)))  # disabled
lng_6 = ListLength(List=e_polyhedra.PolyhedronAsBrep)  # disabled
repeat_6 = RepeatData(Data=txt_4, Length=lng_6)  # -> simplify(Data); disabled
flip_11 = FlipMatrix(Data=entwine_6)  # disabled
flip_12 = FlipMatrix(Data=repeat_6)  # disabled
name = Panel("Polyhedron")  # disabled
layer = Panel("Polyhedra")  # disabled
swatch_9 = ColourSwatch(SwatchColor=RGB(48, 191, 120))  # disabled
attributes_6 = Attributes(
    LayerName=layer,
    ObjectName=name,
    LayerColour=swatch_9,
    ObjectColour=RGB(0, 0, 0),
    PlotColour=RGB(0, 0, 0),
    ColourSource=0,
    UserKeys=flip_12,
    UserValues=flip_11)  # -> flatten(Attributes); disabled
bake_object_v2_6 = BakeObjectV2(Bake=bake_4, Objects=e_polyhedra.PolyhedronAsBrep, Attributes=attributes_6, ParentLayerPath=path_4)  # disabled

bake_5 = Boolean(Button())
path_5 = Text("3DGS::Structure 01::Form Diagram")
_3dgs_8 = Data(_3dgs_3)
e_nodes_2 = ExtractNodes(_3DGS=_3dgs_8, ExtractMethod=0, NodeIndices=0)  # -> LocationsUpdated, IndicesOfNodes, NodeTypes, Forces, NeighboringNodesI, NeighboringEdgesI
panel_22 = Panel("""index
Type
Forces
Neighboring_Nodes
Neighboring_Edges""")
entwine_7 = Entwine(
    Branch00=e_nodes_2.IndicesOfNodes,
    Branch01=e_nodes_2.NodeTypes,
    Branch02=e_nodes_2.Forces,
    Branch03=e_nodes_2.NeighboringNodesI,
    Branch04=e_nodes_2.NeighboringEdgesI,
    FlattenInputs=True)  # -> simplify(Result)
txt_5 = Text(simplify(graft(panel_22)))
transform_9 = Transform(Geometry=e_nodes_2.LocationsUpdated, Transform=transform.t1_2)
lng_7 = ListLength(List=e_nodes_2.LocationsUpdated)
repeat_7 = RepeatData(Data=txt_5, Length=lng_7)  # -> simplify(Data)
transform_10 = Transform(Geometry=transform_9, Transform=transform.t2_2)
flip_13 = FlipMatrix(Data=entwine_7)
flip_14 = FlipMatrix(Data=repeat_7)  # disabled
panel_23 = Panel("Nodes")  # disabled
panel_24 = Panel("Node")  # disabled
swatch_10 = ColourSwatch(SwatchColor=RGB(191, 48, 48))  # disabled
attributes_7 = Attributes(
    LayerName=panel_23,
    ObjectName=panel_24,
    LayerColour=swatch_10,
    ObjectColour=RGB(0, 0, 0),
    PlotColour=RGB(0, 0, 0),
    ColourSource=0,
    UserKeys=flip_14,
    UserValues=flip_13)  # -> flatten(Attributes); disabled
bake_object_v2_7 = BakeObjectV2(Bake=bake_5, Objects=transform_10, Attributes=attributes_7, ParentLayerPath=path_5)  # disabled

bake_6 = Boolean(Button())
path_6 = Text("3DGS::Structure 01::Force Diagram")
_3dgs_9 = Data(_3dgs_3)
e_polyhedra_2 = ExtractPolyhedra(_3DGS=_3dgs_9, ExtractMethod=0, PolyhedraIndices=0)  # -> PolyhedronAsBrep, PolyhedronIndex, Centroid, PolyhedronType
panel_25 = Panel("""index
Type""")
entwine_8 = Entwine(Branch00=e_polyhedra_2.PolyhedronIndex, Branch01=e_polyhedra_2.PolyhedronType, FlattenInputs=True)  # -> simplify(Result)
txt_6 = Text(simplify(graft(panel_25)))
lng_8 = ListLength(List=e_polyhedra_2.PolyhedronAsBrep)
repeat_8 = RepeatData(Data=txt_6, Length=lng_8)  # -> simplify(Data); disabled
flip_15 = FlipMatrix(Data=entwine_8)
flip_16 = FlipMatrix(Data=repeat_8)  # disabled
layer_2 = Panel("Polyhedra")  # disabled
name_2 = Panel("Polyhedron")  # disabled
swatch_11 = ColourSwatch(SwatchColor=RGB(48, 191, 120))  # disabled
attributes_8 = Attributes(
    LayerName=layer_2,
    ObjectName=name_2,
    LayerColour=swatch_11,
    ObjectColour=RGB(0, 0, 0),
    PlotColour=RGB(0, 0, 0),
    ColourSource=0,
    UserKeys=flip_16,
    UserValues=flip_15)  # -> flatten(Attributes); disabled
bake_object_v2_8 = BakeObjectV2(Bake=bake_6, Objects=e_polyhedra_2.PolyhedronAsBrep, Attributes=attributes_8, ParentLayerPath=path_6)  # disabled

panel_26 = Panel("3DGS::Test 01::Meshes")  # disabled
button_4 = Button()  # disabled
mesh_3 = Mesh(mesh)  # disabled
transform_11 = Transform(Geometry=mesh_3, Transform=transform_4.t1_2)  # disabled
transform_12 = Transform(Geometry=transform_11, Transform=transform_4.t2_2)  # disabled
bake_object_v2_9 = BakeObjectV2(Bake=button_4, Objects=transform_12, ParentLayerPath=panel_26)  # disabled

panel_27 = Panel("3DGS::Structure 01::Meshes")  # disabled
button_5 = Button()  # disabled
mesh_4 = Mesh(mesh_2)  # disabled
transform_13 = Transform(Geometry=mesh_4, Transform=transform.t1_2)  # disabled
transform_14 = Transform(Geometry=transform_13, Transform=transform.t2_2)  # disabled
bake_object_v2_10 = BakeObjectV2(Bake=button_5, Objects=transform_14, ParentLayerPath=panel_27)  # disabled

initial = Geometry([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])
relaxed = Geometry([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])

initial_2 = Geometry([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])
relaxed_2 = Geometry([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])

relaxed_3 = Geometry(e_edges.Lines)
geo = Geometry([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])

cluster = Cluster(C=relaxed, R=Slider(4.65, range=0..10))  # -> M, swatch
preview_7 = CustomPreview(Geometry=cluster.M, Material=cluster.swatch)

cluster_2 = Cluster_2(C=relaxed_3, R=Slider(0.92, range=0..10))  # -> M, swatch
preview_8 = CustomPreview(Geometry=cluster_2.M, Material=cluster_2.swatch)

preview_9 = CustomPreview(Geometry=geo, Material=cluster.swatch)

# ==== cluster SetLength
len = ClusterInput()
line = ClusterInput()
len_2 = Number(len)
line_2 = Line(line)
end = EndPoints(Curve=line_2)  # -> Start, End
vec2pt = Vector2Pt(PointA=end.Start, PointB=end.End, Unitize=False)  # -> Vector, Length
line_3 = LineSDL(Start=end.Start, Direction=vec2pt.Vector, Length=len_2)
line_4 = Line(line_3)
line_5 = ClusterOutput(line_4)

# ==== cluster Transform
line = ClusterInput()
z_offset = ClusterInput()
height = ClusterInput()
line_2 = Line(line)
z_offset_2 = Number(z_offset)
height_2 = Number(height)
bbox = BoundingBox(Content=line_2, Plane=PlaneXY(0, 0, 0), UnionBox=True)  # -> Box, Box_2
debox = DeconstructBox(Box=bbox.Box)  # -> Plane, X, Y, Z
dedomain = DeconstructDomain(Domain=debox.Z)  # -> Start, End
neg = Negative(Value=dedomain.Start)
subtraction = Subtraction(A=dedomain.End, B=dedomain.Start)
addition = Addition(A=neg, B=z_offset_2)
pt = ConstructPoint(XCoordinate=0, YCoordinate=0, ZCoordinate=z_offset_2)
division = Division(A=height_2, B=subtraction)
Z = UnitZ(Factor=addition)
move = Move(Geometry=line_2, Motion=Z)  # -> Geometry, Transform
scale = Scale(Geometry=move.Geometry, Center=pt, Factor=division)  # -> Geometry, Transform
line_3 = Line(scale.Geometry)
t2 = Transform(scale.Transform)
t1 = Transform(move.Transform)
t1_2 = ClusterOutput(t1)
t2_2 = ClusterOutput(t2)
bbox_2 = BoundingBox(Content=line_3, Plane=PlaneXY(0, 0, 0), UnionBox=True)  # -> Box, Box_2
line_4 = ClusterOutput(line_3)
edges = BrepEdges(Brep=bbox_2.Box)  # -> Naked, Interior, NonManifold
A = Line(edges.Interior)
A_2 = ClusterOutput(A)

# ==== cluster Cluster
C = ClusterInput()
R = ClusterInput()
mpipe = MeshPipe(Curve=C, Radius=R, Accuracy=0.2, Rotation=0, Segments=10, Caps=2)
swatch = ClusterOutput(ColourSwatch(SwatchColor=RGB(148, 148, 148)))
clean = CombineClean(Meshes=mpipe)
M = ClusterOutput(clean)

# ==== cluster Cluster_2
C = ClusterInput()
R = ClusterInput()
mpipe = MeshPipe(Curve=C, Radius=R, Accuracy=0.2, Rotation=0, Segments=10, Caps=2)
clean = CombineClean(Meshes=mpipe)
M = ClusterOutput(clean)
swatch = ClusterOutput(ColourSwatch(SwatchColor=RGB(148, 148, 148)))
