# Grasshopper definition VisualizePlannedResult.gh (Grasshopper 1.0.7)

python = GhPythonScript(file_name="planning_result_1_newtool")  # -> out, planning_result, collision_geometries, tasks, robotic_movements
# ---------- python: Python ----------
from Rhino.RhinoDoc import ActiveDoc
import os
json_path = os.path.split(ActiveDoc.Path)[0] + os.path.sep + file_name +".json"


from compas.data import json_load

planning_result = json_load(json_path)
tasks = planning_result.tasks
robotic_movements = planning_result.get_robotic_movements()

from compas_ghpython.artists import MeshArtist
collision_geometries = [MeshArtist(cm.mesh).draw() for cm in planning_result.static_collision_meshes]
# ---------- end python ----------
item = ListItem(List=python.robotic_movements, Index=Slider(174, range=0..210), Wrap=True)
mesh = Mesh(python.collision_geometries)
python_2 = GhPythonScript(robotic_movement=item)  # -> out, configuration
# ---------- python_2: Python ----------
configuration = robotic_movement.trajectory
# ---------- end python_2 ----------
item_2 = ListItem(List=python_2.configuration, Index=Slider(-1, range=-1..10), Wrap=True)

# ----
# Visualize Robot Model (Cannot plan here)
reload_urdf = Button()
load_tool = GhPythonScript()  # -> out, tool_model
# ---------- load_tool: Python ----------
import rhinoscriptsyntax as rs
from compas.data import DataDecoder, DataEncoder
import json
import os

this_file_location = os.path.dirname(rs.DocumentPath())
tool_json_location = os.path.abspath(os.path.join(
    this_file_location,
    "..", "..",
    "tool","BioPrint901","BioPrint901.json"
    ))
    
with open(tool_json_location, 'r') as f:
    tool_model = json.load(f, cls=DataDecoder)
# ---------- end load_tool ----------
load_robot_for_visualization = GhPythonScript(x=reload_urdf)  # -> out, robot
# ---------- load_robot_for_visualization: Python ----------
import rhinoscriptsyntax as rs

import compas
import compas_fab
import os

this_file_location = os.path.dirname(rs.DocumentPath())
robot_package_location = os.path.abspath(os.path.join(
    this_file_location,
    "..", "..",
    "robot"
    ))
robot_urdf_location = os.path.abspath(os.path.join(
    this_file_location,
    "..", "..",
    "robot","abb_crb15000_support",
    "urdf", "crb15000_5_95.urdf"
    ))
robot_srdf_location = os.path.abspath(os.path.join(
    this_file_location,
    "..", "..",
    "robot","abb_crb15000_support",
    "srdf", "abb_crb15000_5_95.srdf"
    ))

# Set high precision to import meshes defined in meters
compas.PRECISION = '12f'

# Create robot model from URDF
from compas.robots import RobotModel
robot_model = RobotModel.from_urdf_file(robot_urdf_location)

# Load Link Geometry
from compas.robots import LocalPackageMeshLoader
loader = LocalPackageMeshLoader(robot_package_location, 'abb_crb15000_support')
robot_model.load_geometry(loader)

# Load Robot Semantics from srdf
from compas_fab.robots import RobotSemantics
semantics = RobotSemantics.from_srdf_file(robot_srdf_location, robot_model)

print(robot_model)
for i, link in enumerate(robot_model.links):
    print ("Link [{}]: {}".format(i, link.name))
    
# Create compas_fab Robot object
from compas_ghpython.artists import RobotModelArtist
from compas_fab.robots import Robot
artist = RobotModelArtist(robot_model)

robot = Robot(robot_model, artist, semantics) # compas_fab Robot object
# ---------- end load_robot_for_visualization ----------
python_3 = GhPythonScript(robot=load_robot_for_visualization.robot, tool_model=load_tool.tool_model, tool_to_link_name="tool0")  # -> out, robot
# ---------- python_3: Python ----------
import rhinoscriptsyntax as rs
from compas_ghpython.artists import RobotModelArtist
from compas.geometry import Transformation, Frame
from compas_fab.robots import Robot

# Defining the link where the tool is attached to
tool_model.link_name = tool_to_link_name 

from compas_fab.robots import Tool
tool = Tool.from_tool_model(tool_model)
robot.attach_tool(tool, robot.main_group_name)
# ---------- end python_3 ----------
update_robot = GhPythonScript(
    robot=python_3.robot,
    J1=Slider(0, range=0..1),
    J2=Slider(0, range=0..1),
    J3=Slider(0, range=0..1),
    J4=Slider(0, range=0..1),
    J5=Slider(0.7, range=0..1),
    J6=Slider(0, range=0..1))  # -> out, robot, configuration
# ---------- update_robot: Python ----------
import rhinoscriptsyntax as rs
configuration = robot.model.zero_configuration()
configuration['joint_1'] = J1
configuration['joint_2'] = J2
configuration['joint_3'] = J3
configuration['joint_4'] = J4
configuration['joint_5'] = J5
configuration['joint_6'] = J6
robot.update(configuration)
print (configuration)
# ---------- end update_robot ----------

update_robot_2 = GhPythonScript(robot=python_3.robot, configuration_in=item_2)  # -> out, robot, configuration
# ---------- update_robot_2: Python ----------
import rhinoscriptsyntax as rs
configuration = robot.model.zero_configuration()
configuration.merge(configuration_in)
#configuration['joint_1'] = J1
#configuration['joint_2'] = J2
#configuration['joint_3'] = J3
#configuration['joint_4'] = J4
#configuration['joint_5'] = J5
#configuration['joint_6'] = J6
robot.update(configuration)
print (configuration)
# ---------- end update_robot_2 ----------

python_4 = GhPythonScript(robot=update_robot_2.robot)  # -> out, robot_visual_meshes, robot_collision_meshes
# ---------- python_4: Python ----------
robot_visual_meshes = robot.artist.draw_visual()
robot_collision_meshes = robot.artist.draw_collision()
# ---------- end python_4 ----------
