# Grasshopper definition BioPrintDefT901.gh (Grasshopper 1.0.7)

# ----
# Development Tools
# Reload Python Modules (if Module Code is Changed)
python_module_to_reload = Panel("""compas
compas_fab
roslibpy
integral_timber_joints""")
reload = Button()
py = PythonScript(reload_module_button=reload, module_names=python_module_to_reload)  # inputs module_names: list
# ---------- py: Python ----------
import compas_ghpython
from compas_ghpython import unload_modules
if reload_module_button:
    for module in module_names:
        unload_modules(module)
# ---------- end py ----------

# ----
# Check Path and Environment
compas_version = GhPythonScript()  # -> out, compas_version, compas_fab_version, compas_path, compas_fab_path, compas_env_name, python_directory
# ---------- compas_version: Python ----------
__author__ = "leungp"
__version__ = "2020.04.20"

import rhinoscriptsyntax as rs
import compas
import compas_fab
compas_version  = compas.__version__
compas_fab_version = compas_fab.__version__
import os
compas_path = os.path.abspath(compas.__file__)
compas_fab_path = os.path.abspath(compas_fab.__file__)

import compas_bootstrapper
compas_env_name = compas_bootstrapper.ENVIRONMENT_NAME
python_directory = compas_bootstrapper.PYTHON_DIRECTORY
# ---------- end compas_version ----------
# Otto's Hand
compas_environment_name = Panel(compas_version.compas_env_name)
compas_version_2 = Panel(compas_version.compas_version)
compas_fab_version = Panel(compas_version.compas_fab_version)
compas_path = Panel(compas_version.compas_path)
compas_fab_path = Panel(compas_version.compas_fab_path)
python_directory = Panel(compas_version.python_directory)

meshes = Mesh([<mesh referenced from the Rhino model> x2])
frame_curves_y = Curve(<curve referenced from the Rhino model>)
end = EndPoints(Curve=frame_curves_y)  # -> Start, End

# ----
# Test Changing Base Location
number_slider = Slider(0, range=0..300)
pt = ConstructPoint(XCoordinate=Slider(1, range=0..300), YCoordinate=number_slider, ZCoordinate=0)
xy = XYPlane(Origin=pt)
xz = XZPlane(Origin=Point(0, 0, 0))
rotate = Rotate(Geometry=xy, Angle=degrees(Slider(55, range=0..300)), Plane=xz)  # -> Geometry, Transform

# ----
# Tool Definition - otto1
# Model the tool changer such that the model at the orgin will be attach to the robot flange.
# 
# Tool changer is a subclass of Tool, however only one instance exist in a given Process. Therefor the name and type_name is the same to simplify things.
# Identifyable name for the tool changer
# Tool Coodinate Frame -
# The tool will attach to this point.
# Approach Vector -
# Vector for the Toolchanger (RobotSide) to dock with Clamp/Screwdriver
panel = Panel("BioPrintDefT901")
meshes_2 = Mesh([<mesh referenced from the Rhino model> x2])
frame_curves_x = Curve(<curve referenced from the Rhino model>)

end_2 = EndPoints(Curve=frame_curves_x)  # -> Start, End
pl_3pt = Plane3Pt(PointA=end_2.Start, PointB=end_2.End, PointC=end.End)

pln = Plane(pl_3pt)
create_toolchanger = GhPythonScript(tool_name=panel, visual_meshes=meshes, collision_meshes=meshes_2, tool_coordinate_frame=pln)  # -> out, robot_model; inputs visual_meshes: list of Mesh, collision_meshes: list of Mesh, tool_coordinate_frame: Plane
# ---------- create_toolchanger: Python ----------
#from compas_ghpython import unload_modules
#unload_modules("integral_timber_joints")

from compas.datastructures import Mesh

from compas_rhino.geometry import RhinoPlane, RhinoMesh, RhinoVector
from compas.robots import ToolModel

tool_coordinate_frame = RhinoPlane.from_geometry(tool_coordinate_frame).to_compas_frame()
collision_meshes = [RhinoMesh.from_geometry(m).to_compas() for m in collision_meshes]
visual_meshes = [RhinoMesh.from_geometry(m).to_compas() for m in visual_meshes]

robot_model = ToolModel(
    visual_meshes,
    tool_coordinate_frame,
    collision_meshes,
    name = tool_name)
# ---------- end create_toolchanger ----------

# ----
# Save
# Save location next to Rhino File
# Fle name = tool_name.json
auto_path = GhPythonScript(tool_name=panel)  # -> json_path
# ---------- auto_path: Python ----------
from Rhino.RhinoDoc import ActiveDoc
import os
json_path = os.path.split(ActiveDoc.Path)[0] + os.path.sep + tool_name +".json"
pickle_path = os.path.split(ActiveDoc.Path)[0] + os.path.sep + tool_name +".pickle"
# ---------- end auto_path ----------
save = Button()
python = GhPythonScript(tool_model=create_toolchanger.robot_model, json_path=auto_path, output=save)  # -> out, json_path, a
# ---------- python: Python ----------
from compas.data import DataDecoder, DataEncoder
import json
if output:
    with open(json_path, 'w') as f:
        json.dump(tool_model, f, cls=DataEncoder, indent=4, sort_keys=True)
# ---------- end python ----------

deepcopy = GhPythonScript(data_in=create_toolchanger.robot_model)  # -> data_out
# ---------- deepcopy: Python ----------
from copy import deepcopy

data_out = deepcopy(data_in)
# ---------- end deepcopy ----------
panel_2 = Panel(python.out)
robot_artist = GhPythonScript(tool_model=deepcopy, current_frame=rotate.Geometry)  # -> out, visual; inputs current_frame: Plane
# ---------- robot_artist: Python ----------
from compas_ghpython.artists import RobotModelArtist
from compas_rhino.geometry import RhinoPlane
from compas.geometry import Transformation, Frame

# Create a transformation for base location
if current_frame:
    current_cframe = RhinoPlane.from_geometry(current_frame).to_compas_frame()
    tool_model.current_frame = current_cframe

    tool_model.current_transformation = Transformation.from_frame_to_frame(Frame.worldXY(), current_cframe)
#compas_visual_mesh = tool_model.draw_visual()
#print (compas_visual_mesh)

artist = RobotModelArtist(tool_model)
artist.update(())
visual = artist.draw_visual()
# ---------- end robot_artist ----------

# ----
# Load Test
load_tool = GhPythonScript(json_path=python.json_path)  # -> out, tool_model
# ---------- load_tool: Python ----------
from compas.data import DataDecoder, DataEncoder
import json
with open(json_path, 'r') as f:
    tool_model = json.load(f, cls=DataDecoder)
# ---------- end load_tool ----------
python_2 = GhPythonScript(tool_model=load_tool.tool_model)  # -> out
# ---------- python_2: Python ----------
print ('tool_model type:', type(tool_model))
print ('tool_model:', tool_model)
print ('name:', tool_model.name)
print ("Links: ")
for link in tool_model.links:
    print(" - {}".format(link.name))
    print("  ({} Collision Geometry, {} Visual Geometry)".format(len(link.collision),len(link.visual)))
print ("Joints: ")
for joint in tool_model.joints:
    print(" - {}".format(joint.name))
# ---------- end python_2 ----------
# Test Changing Base Location
# Parallel Gripper - PG500
# Save
# Save
# Load Test
# Load Test
# Test Motion
# Test Motion
# Artist
# Artist
# Test Changing Base Location
# Parallel Gripper - PG1000
# Save
# Load Test
# Artist
# Test Motion
# Save
# Load Test
# Test Motion
# Artist
# Parallel Gripper - PG1500
# Save
# Load Test
# Test Motion
# Artist
panel_3 = Panel(python_2)
